# Grasshopper definition tapir_wip_rc1.ghx (Grasshopper 1.0.7)
# plug-ins: tAPIr, eleFront

# ---- group: highlight
button = Button()
getelements = GetElements(Update=button)
ghpython_script = GhPythonScript(Elements=getelements, Highlight=button)  # inputs Elements: list, Highlight: Boolean
# ---------- ghpython_script: Python ----------
import tapir, tapir_py

archicad = tapir.Plugin.Archicad
if True:
    archicad.HighlightElements(Elements)
# ---------- end ghpython_script ----------

# ---- group: ClassificationSystems
handshake = Handshake(Refresh=Button())
panel = Panel(handshake)
getclassifications = GhPythonScript(classification=handshake)  # -> children; inputs classification: tree
# ---------- getclassifications: Python ----------
import tapir, tapir_py
from ghpythonlib.treehelpers import list_to_tree

items = []
tree = classification
archicad = tapir.Plugin.Archicad

for branch_index in range(tree.BranchCount):
    branch = tree.Branch(branch_index)
    branch_item = []
    for leaf in branch:
        
        if isinstance(leaf, tapir_py.core.Command):
            objects = leaf.GetAllClassificationSystems()
            branch_item.append(objects)
        
        elif isinstance(leaf, tapir_py.parts.ClassificationSystem):
            objects = archicad.GetAllClassificationsInSystem(leaf)
            branch_item.append(objects)
    
        elif isinstance(leaf, tapir_py.parts.ClassificationItem):
            objects = leaf.children
            branch_item.append(objects)
    
    items.append(branch_item)

items = list_to_tree(items)
children = items
# ---------- end getclassifications ----------
list_item = ListItem(List=getclassifications, Index=0, Wrap=True)
panel_2 = Panel(list_item)
getclassifications_2 = GhPythonScript(classification=list_item)  # -> children; inputs classification: tree; same code as getclassifications
list_item_2 = ListItem(List=getclassifications_2, Index=0, Wrap=True)
getclassifications_3 = GhPythonScript(classification=list_item_2)  # -> children; inputs classification: tree; same code as getclassifications
list_item_3 = ListItem(List=getclassifications_3, Index=Slider(2, range=0..10), Wrap=True)
getclassifications_4 = GhPythonScript(classification=list_item_3)  # -> children; inputs classification: tree; same code as getclassifications

# ----
panel_3 = Panel("READ / WRITE CLASSIFICATIONS")
panel_4 = Panel("READ / WRITE PROPERTIES")
value_list = ValueList({"One": 1, "Two": 2, "Three": 2² - 1, "Four": Sqrt(16)}, selected="One")

# ----
# Change or Modify Classification System of existing Element
getallclassificationsystems = GetAllClassificationSystems(PickSystem=0)  # -> ClassificationSystems, Name, Source, Version, Date, Description, ClassSystemID
# ---------- getallclassificationsystems: Python ----------
ghenv.Component.Name = 'Get All Classification Systems'
ghenv.Component.NickName = 'GetAllClassificationSystems'
ghenv.Component.Message = '0.1'
ghenv.Component.Category = 'ARCHICAD'
ghenv.Component.SubCategory = 'API3'
ghenv.Component.Description = '''
Collects all classifications systems
INPUT:
	PickSystem    : int  		: Picks Property group
						  

OUTPUT:
	ClassificationSystems 	    : Message 	 
	Name 						: String
	Name 						: String
'''



import  api2 as api 


ports = api.get_active_port()

_systems=[]
if len(ports)>0 and PickSystem is not None :
	for port in ports:
		_systems += api.getAllClassificationSystems(port)

	_class_name=[]
	for s in _systems:
		_class_name.append(s['name'])

	PickSystem_wrapped = api.get_wrapped_value(PickSystem,_class_name)
	ClassificationSystems = api.show_menu('CLASSIFICATION SYSTEMS',_class_name,PickSystem_wrapped)
	Name = _systems[PickSystem_wrapped]['name']
	Source = _systems[PickSystem_wrapped]['source']
	Version = _systems[PickSystem_wrapped]['version']
	Date = _systems[PickSystem_wrapped]['date']
	Description = _systems[PickSystem_wrapped]['description']
	ClassSystemID = _systems[PickSystem_wrapped]['guid']
# ---------- end getallclassificationsystems ----------
getclassificationsinsystem = GetClassificationsInSystem()  # -> printToPanel, ClassID, ClassName, ClassDescription, ClassGUID; inputs PickClass: Int32
# ---------- getclassificationsinsystem: Python ----------
ghenv.Component.Name = 'Get Classifications In System'
ghenv.Component.NickName = 'GetClassificationsInSystem'
ghenv.Component.Message = '0.1'
ghenv.Component.Category = 'ARCHICAD_API'
ghenv.Component.SubCategory = 'Classification'
ghenv.Component.Description = '''
Collects all classifications systems
INPUT:
	PickSystem    : int  		: Picks Property group
						  

OUTPUT:
	ClassificationSystems 	    : Message 	 
	Name 						: String
	Name 						: String
'''

#https://archicadapi.graphisoft.com/JSONInterfaceDocumentation/#GetAllClassificationsInSystem

import  api2 as api 
ports = api.get_active_port()
port = ports[0]
classifications_menu=[]
className 	= []
classId 	= []
classDesc 	= []
classGUID 	= []
if len(ports)>0 and PickClass is not None:
	# for port in ports:
	classes = api.GetAllClassificationsInSystem(port,ClassSystemID)
	for c in classes:
		classifications_menu.append(c['classificationItem']['id'])
		classId.append(c['classificationItem']['id'])
		className.append(c['classificationItem']['name'])
		classDesc.append(c['classificationItem']['description'])
		classGUID.append(c['classificationItem']['classificationItemId']['guid'])
		try:
			for child in c['classificationItem']['children']:
				classifications_menu.append('\t\t|__\t'+child['classificationItem']['id'])
				classId.append(child['classificationItem']['id'])
				classGUID.append(child['classificationItem']['classificationItemId']['guid'])
				className.append(child['classificationItem']['name'])
				classDesc.append(child['classificationItem']['description'])

		except:
			pass
	PickClass_wrapped = api.get_wrapped_value(PickClass,classifications_menu)
	printToPanel = api.show_menu('CLASSIFICATIONS IN {}'.format('system'),classifications_menu,PickClass_wrapped)
	
	ClassID = classId[PickClass_wrapped]
	ClassGUID = classGUID[PickClass_wrapped]
	ClassName = className[PickClass_wrapped]
	ClassDescription = classDesc[PickClass_wrapped]
	# for c  in classifications:

	# 	print c
else:	
	print 'Connect INPUT'
# ---------- end getclassificationsinsystem ----------
setclassificationofelements = SetClassificationOfElements()  # -> printToPanel
# ---------- setclassificationofelements: Python ----------
ghenv.Component.Name = 'Set Classification Of Elements'
ghenv.Component.NickName = 'SetClassificationOfElements'
ghenv.Component.Message = '0.1'
ghenv.Component.Category = 'ARCHICAD_API'
ghenv.Component.SubCategory = 'Classification'
ghenv.Component.Description = '''
Collects all classifications systems
INPUT:
	PickSystem    : int  		: Picks Property group
						  

OUTPUT:
	ClassificationSystems 	    : Message 	 
	Name 						: String
	Name 						: String
'''

#https://archicadapi.graphisoft.com/JSONInterfaceDocumentation/#SetClassificationsOfElements

import  api2 as api 
ports = api.get_active_port()
port = ports[0]
run = api.get_global_toggle()

if len(ports)>0 and ElementsID is not None and ClassSystemID is not None and ClassGUID is not None:
	_elementsID = api.unpack(ElementsID)

	json_def = api.SetClassificationsOfElements(port,_elementsID,ClassSystemID,ClassGUID)

	result = api.connect(json_def,port)
	printToPanel = result['succeeded']
else: 
	printToPanel = 'Connect all INPUT wires'
# ---------- end setclassificationofelements ----------

# ---- group: SELECTION OF ARCHICAD SESSION AND ELEMENTS TO EDIT
getelementsbytype = GetAllElementsByType(ElementType=0, SerializeElements=True)  # -> printToPanel, ElementsOfType; inputs ElementType: Int32, SerializeElements: Boolean
# ---------- getelementsbytype: Python ----------
ghenv.Component.Name = 'Get All elements by Type'
ghenv.Component.NickName = 'GetElementsByType'
ghenv.Component.Message = '0.1'
ghenv.Component.Category = 'ARCHICAD'
ghenv.Component.SubCategory = 'API3'
ghenv.Component.Description = '''
Collects GUIDS of all elements in a project by thier type
INPUT:
	ElementType  : int Choose type. Connect Number slider from 0 to 17
				
OUTPUT:
	printToPanel 	: string - Display list of all types. 
	ElementsOfType 	: dict - Elements packed to dictionary
'''

import api2 as p
reload(p)

ports = p.get_active_port()

el_types = p.getElementsTypes()

if ElementType is not None and isinstance(ElementType,int):
	wrapped_ElementType = p.get_wrapped_value(ElementType,el_types)

	printToPanel = p.show_menu('Element Types',el_types,wrapped_ElementType)

	choosen_type = el_types[wrapped_ElementType]


	_ElementsOfType=[]
	for port in ports:
		elem = p.getElementsByType(choosen_type,port)
		elem = p.unpack(elem)['elements']
		_ElementsOfType+=elem
	if SerializeElements:   
		ElementsOfType = p.packlist(_ElementsOfType)
	else:
		ElementsOfType = _ElementsOfType

	# ElementsOfType = p.pack('elements',_ElementsOfType)
else:
	printToPanel = 'CAUTION:\nConnect Number Slider to <ElementType> Input'
# ---------- end getelementsbytype ----------
# SELECTION OF ELEMENTS IN ARCHICAD
getallelements = GetAllElements(SerializeElements=True)  # -> ElementsID; inputs SerializeElements: Boolean
# ---------- getallelements: Python ----------
ghenv.Component.Name = 'Get All Elements'
ghenv.Component.NickName = 'GetAllElements'
ghenv.Component.Message = '0.1'
ghenv.Component.Category = 'ARCHICAD'
ghenv.Component.SubCategory = 'API3'
ghenv.Component.Description = '''
Collects GUIDS of all elements in a project 
				
OUTPUT:
	ElementsID 	: dict - Elements packed to dictionary
'''

import api2 as p


ports = p.get_active_port()

_ElementsID=[]
if len(ports)>0:
	# port = ports[0]
	for port in ports:
		el = p.getAllElements(port)
		el = p.unpack(el)
		_ElementsID+=el['elements']
	print type(_ElementsID),len(_ElementsID)
	
	if SerializeElements:
		ElementsID = p.packlist(_ElementsID) 
	else:
		ElementsID = _ElementsID 
	# ElementsID = p.pack('elements',_ElementsID)
# ---------- end getallelements ----------
getelementsbyclassification = GetElementsByClassification(SerializeElements=1)  # -> ElementsID; inputs SerializeElements: Boolean
# ---------- getelementsbyclassification: Python ----------
ghenv.Component.Name = 'Get Elements by Classification'
ghenv.Component.NickName = 'GetElementsByClassification'
ghenv.Component.Message = '0.1'
ghenv.Component.Category = 'ARCHICAD_API'
ghenv.Component.SubCategory = 'Classification'
ghenv.Component.Description = '''
Collects all classifications systems
INPUT:
	PickSystem    : int  		: Picks Property group
						  

OUTPUT:
	ClassificationSystems 	    : Message 	 
	Name 						: String
	Name 						: String
'''

# https://archicadapi.graphisoft.com/JSONInterfaceDocumentation/#GetElementsByClassification

import  api2 as api 
ports = api.get_active_port()
port = ports[0]
run = api.get_global_toggle()


if len(ports)>0 and ClassGUID is not None:
    
	_elementsID = api.GetElementsByClassification(port,ClassGUID)

	if SerializeElements:   
		ElementsID = _elementsID
	else:
		ElementsID = api.unpack(_elementsID)
		
else:
	printToPanel = 'Connect all inputs'
# ---------- end getelementsbyclassification ----------
pickport = PickConnectionPort(Synchronise=1, pickPort=0, RunGlobally=1)  # -> printToPanel; inputs Synchronise: Boolean, pickPort: Int32, RunGlobally: Boolean
# ---------- pickport: Python ----------
ghenv.Component.Name = 'Pick connection port'
ghenv.Component.NickName = 'PickPort'
ghenv.Component.Message = '0.1'
ghenv.Component.Category = 'ARCHICAD'
ghenv.Component.SubCategory = 'API3'
ghenv.Component.Description = '''
Checks avaliable connection ports and dallows to pick one or all
INPUT:
	Synchronise  : bool Checks avaliable ports. 
						For performance reason should be set to false after first run
	pickPort     : int  Connect Integer type <Number Node> 
	RunGlobally  : bool Turns on/off global variable on which depends  other nodes performance.   
OUTPUT:
	printToPanel : string Message
'''
# ghenv.Component.AdditionalHelpFromDocStrings = '1'



import api2 as api
reload(api)
printToPanel = Synchronise
api.set_global_toggle(RunGlobally)
p=None
ports = []

if Synchronise == True:

    ports = api.open_ports()
    
    p = api.get_port()

    if len(p)>1:
        p =  p + [p]

if p and pickPort is not None:
    wrapped_pickPort = api.get_wrapped_value(pickPort,p)
    printToPanel = api.show_menu('Avaliable ports',p,wrapped_pickPort)
    api.set_active_port(p[wrapped_pickPort])
else:
    printToPanel = 'Plug Boolean Toggle node to Synchronise Input\nand Number Slider to pickPort Input'
# ---------- end pickport ----------
filter_elements = FilterElements()
getelementsid = GetElementsID()  # -> ElementsID
# ---------- getelementsid: Python ----------
ghenv.Component.Name = 'Get Elements ID'
ghenv.Component.NickName = 'GetElementsID'
ghenv.Component.Message = '0.1'
ghenv.Component.Category = 'ARCHICAD'
ghenv.Component.SubCategory = 'API3'
ghenv.Component.Description = '''
Output elements guids from Archicad element containers                
INPUT:
    Elements from Archicad container. All types allowed
OUTPUT:
    ElementsID  : Json object consist of collected guids
'''

import api2 
reload(api2)

if Elements is not None:
    ElementsID = str(Elements.Guid)
# ---------- end getelementsid ----------

# ----
getuseerdefinedpropertyid = GetUserDefinedPropertyID(PropertyGroup=0, Property=0)  # -> printToPanel, PropertyGroups, PropertiesInGroup, PropertyID; inputs PropertyGroup: Int32, Property: Int32
# ---------- getuseerdefinedpropertyid: Python ----------
ghenv.Component.Name = 'Get UserDefined Property ID'
ghenv.Component.NickName = 'GetUseerDefinedPropertyID'
ghenv.Component.Message = '0.1'
ghenv.Component.Category = 'ARCHICAD'
ghenv.Component.SubCategory = 'API3'
ghenv.Component.Description = '''
Picks GUID of User defined Property
INPUT:
	PropertyGroup    : int  		: Picks Property group
	Property         : int  		: Picks properties in a group
						  

OUTPUT:
	printToPanel 	    : Message 	 
	PropertyGroups 	    : Message 	:Property groups based on name prefix 
	PropertiesInGroup	: Message 	:properties in a group

	PropertyID 			: string 	: GUID of property
'''


import api2 as api 
reload(api)
ports = api.get_port()
port = ports[0]

run  = api.get_global_toggle()
print 'sdfs',run
ud_groups , ud_properties = api.getUserDefinedPropertyGroups(port)

if len(ports)>0 or PropertyGroups is not None and Property is not None: 
	PropertyGroup_wrapped = api.get_wrapped_value(PropertyGroup,ud_groups) 
	_group = ud_groups[PropertyGroup_wrapped]
	_properties_in_group = ud_properties[_group]
	Property_wrapped = api.get_wrapped_value(Property,_properties_in_group) 
	print 	Property,Property_wrapped

	PropertyGroups = api.show_menu('GROUPS',ud_groups,PropertyGroup_wrapped)



	PropertiesInGroup = api.show_menu(
		'PROPERTIES IN GROUP "{}"'.format(_group),
		_properties_in_group,
		Property_wrapped
		)
	_property_name = _properties_in_group[Property_wrapped]

	if run:
		PropertyID  = api.getUserDefinedPropertyId(_group,_property_name,port)
		printToPanel = 'Global toggle is on'
	else:
		PropertyID  = ''
		printToPanel = 'GH scheme is globally turned off. Use Input <RunGlobally> in PickPort Node\n'
		

else:
	printToPanel = '''
INPUT:
	PropertyGroups: int
	Property: 		int
OUTPUT:
	PropertyGroups 		:list of groups printed to Panel node
	PropertiesInGroup 	:list of properties in chosen group  printed to Panel node
	PropertyID 			:str Property GUID as string
	'''

# choosen_property_name = ud_properties[Property_wrapped]
# ---------- end getuseerdefinedpropertyid ----------
getbuiltinpropertyid = GetBuiltInPropertyID(PropertyType=15, Property=1)  # -> PropertyGroups, PropertiesOfType, PropertyID; inputs PropertyType: Int32
# ---------- getbuiltinpropertyid: Python ----------
ghenv.Component.Name = 'Get BuiltIn Property ID'
ghenv.Component.NickName = 'GetBuiltInPropertyID'
ghenv.Component.Message = '0.1'
ghenv.Component.Category = 'ARCHICAD'
ghenv.Component.SubCategory = 'API3'
ghenv.Component.Description = '''
Checks avaliable connection ports and dallows to pick one or all
INPUT:
	PropertyType    : int  		: Picks Property group
	Property        : int  		: Picks properties in group
						  

OUTPUT:
	PropertyGroups 	: Message 	:Property groups based on name prefix 
	PropertiesOfType 	: Message 	:properties in group

	PropertyID 			: string 	: GUID of property
'''


import api2 as api 

#read avaliable ports from GH global (sticky)
ports = api.get_port()
if ports == False:
    port = 0
else:
    port = ports[0]


if ports != False and len(ports)>0 and (PropertyType is not None and Property is not None):

	property_names = api.getBuiltInPropertyNames(port) # get names of builtIn properties
	property_types = api.getBuiltInPropertyTypes(port) # get types from names (first word before underscore)

	PropertyType_wrapped = api.get_wrapped_value(PropertyType,property_types) # wrapup input number slide node to fit list lenngth
	PropertyGroups  = api.show_menu('PROPERTY TYPES',property_types,PropertyType_wrapped)

	_properties_of_type = api.getBuiltInPropertiesOfType(property_names,port,property_types[PropertyType_wrapped]) 

	Property_wrapped = api.get_wrapped_value(Property,_properties_of_type)
	PropertiesOfType = api.show_menu('{} PROPERTIES'.format(property_types[PropertyType_wrapped]), _properties_of_type,Property_wrapped)

	property_name = _properties_of_type[Property_wrapped]

	# PropertyID = property_name
	PropertyID = api.getBuiltInPropertyId(property_name,port)

else:
	PropertyGroups = 'Plug INPUTS'
# ---------- end getbuiltinpropertyid ----------
getpropertyvalue = GetPropertyValue(SerializeList=1)  # -> PropertyValue; inputs SerializeList: Boolean
# ---------- getpropertyvalue: Python ----------
ghenv.Component.Name = 'Get Property Value'
ghenv.Component.NickName = 'GetPropertyValue'
ghenv.Component.Message = '0.1'
ghenv.Component.Category = 'ARCHICAD'
ghenv.Component.SubCategory = 'API3'
ghenv.Component.Description = '''
Gets value of given property GUID
INPUT:
	PropertyID         : string  : GUID of Property
	ElementsID         : dict    : dictionary of elements GUID
	UnpackValue        : dict    : dictionary of elements GUID
						  

OUTPUT:
	PropertyValue 	    : dict 	 : Dicionary with 3 keys: value,type and status
	
'''


import api2 as api 

ports = api.get_port()
port = ports[0]


if len(ports)>0 and (PropertyID is not None and ElementsID is not None):
	# if isinstance(ElementsID,str):
	if len(ElementsID)!=36:
		ElementsID = api.unpack(ElementsID)
	else:
		ElementsID = [ElementsID]


	property_value = api.getPropertyValue(ElementsID,[PropertyID],port)
	# print property_value



# ports = api.get_port()
# port = ports[0]

values=[]
if len(ports)>0 and (PropertyID is not None and ElementsID is not None):
	el = ElementsID
	# el = api.unpack(ElementsID)
	# el = api.unpack(ElementsID)['elements']
	property_value = api.getPropertyValue(el,[PropertyID],port)
	for i in property_value:
		values.append(i)
		# values.append(i['value'])

	if SerializeList:
		PropertyValue = api.packlist(property_value)	
	else:
		__val=[]
		for i in values:
			__val.append(i['value'])
			PropertyValue = __val
		# PropertyValue = values
# ---------- end getpropertyvalue ----------
setpropertyvalue = SetPropertyValue()  # -> printToPanel
# ---------- setpropertyvalue: Python ----------
ghenv.Component.Name = 'Set Property Value'
ghenv.Component.NickName = 'SetPropertyValue'
ghenv.Component.Message = '0.1'
ghenv.Component.Category = 'ARCHICAD'
ghenv.Component.SubCategory = 'API3'
ghenv.Component.Description = '''
Sets value of given property GUID
INPUT:
	PropertyID         : string  : GUID of Property
	ElementsID         : dict    : dictionary of elements GUID
	SetValue           : dict    : values packed
						  

OUTPUT:
	PropertyValue 	    : dict 	 : Dicionary with 3 keys: value,type and status
	
'''

import api2 as api
reload(api)


ports = api.get_port()
port = ports[0]

run = api.get_global_toggle()

# def convert_types(value,type_name):
# 	if type_name=='number':return float(value)
# 	if type_name=='string':return str(value)
if len(ports)>0 and (PropertyID is not None and ElementsID is not None and SetValue is not None):
	_elements = api.unpack(ElementsID)
	# _elements = api.unpack(ElementsID)['elements']
	property_value = api.getPropertyValue(_elements,[PropertyID],port)
	
	types = [t['type'] for t in property_value]
	new_values = api.unpack(SetValue)
	# new_values = api.unpack(SetValue)['values']
	# todo: recognize type !!
	types_values = zip(new_values,types)



	
	for i in range(len(new_values)):
		property_value[i]['value'] = api.convert_types(new_values[i],types[i])
		property_value[i]['type'] =  types[i]
		# property_value[i]['value'] =  new_values[i]
	
	# print property_value
	
	if run:
		printToPanel = api.setPropertyValue(_elements,PropertyID,property_value,port)
	else:
		printToPanel = 'GH scheme is globally turned off. Use Input <RunGlobally> in PickPort Node'
else: 
	printToPanel = '''
INPUT:
	PropertyID : string
	ElementsID : list
OUTPUT:
	printToPanel: message
	'''
# ---------- end setpropertyvalue ----------

# ---- group: Classification Systems
# Classification System (Tree)
# Classification In (Classification)System (branch)
# Classification In (Classification)System (leaf)
getallclassificationsystems_2 = GetAllClassificationSystems(PickSystem=0)  # -> ClassificationSystems, Name, Source, Version, Date, Description, ClassSystemID; same code as getallclassificationsystems
getclassificationsinsystem_2 = GetClassificationsInSystem()  # -> printToPanel, ClassID, ClassName, ClassDescription, ClassGUID; inputs PickClass: Int32; same code as getclassificationsinsystem
# Todo: Language Support for non-ASCII Characters
# Eto Form for selecting Classification System from Tree
# Explode Object automatically to it's properties
panel_5 = Panel("Recursive Branch Structure")

# ----
# Get By Classification
# Get By Type
getelements_2 = GetElements(Update=True)
getclassificationsystems = GetClassificationSystems()

getelementsbyclassification_2 = GetElementsByClassification()  # -> Names, Elements

# ---- group: Round 3
archicadschedule = ARCHICADSchedule()  # -> printHeaders, ElementsID, Values; inputs IdFields: Int32
# ---------- archicadschedule: Python ----------
ghenv.Component.Name = 'ARCHICAD Schedule'
ghenv.Component.NickName = 'ARCHICADSchedule'
ghenv.Component.Message = '0.1'
ghenv.Component.Category = 'ARCHICAD'
ghenv.Component.SubCategory = 'API3'
ghenv.Component.Description = '''Reads archicad's schedule saved 
as tabbed txt  file

'''
import api2 as api
import csv
import json
# print(csvFile)
if Delimiter is None:
    Delimiter = '\t'
data = []
ids = []
headers = []
_headers = []
if IdFields is not None and ValuesFields is not None and csvFile is not None:
	with open(csvFile, 'r') as f:
		reader = csv.reader(f,delimiter=Delimiter)
		for row in reader:
			_headers.append(row)
		headers = _headers[0]

	wrapped_IdFields = api.get_wrapped_value(IdFields,headers)
	wrapped_valuesFields = api.get_wrapped_value(ValuesFields,headers)
	printHeaders = api.show_menu_two_inputs('DATA HEADERS',headers,wrapped_IdFields,wrapped_valuesFields)
	# printHeaders = api.show_menu('DATA HEADERS',headers,wrapped_IdFields)





	with open(csvFile, 'r') as f:
		csvData = csv.reader(f,delimiter=Delimiter)
		
		for row in csvData:
			data.append(row[wrapped_IdFields])
			ids.append(row[wrapped_valuesFields])
		data.pop(0)
		ids.pop(0)



	# pack = json.dumps({'elements':data},)
	ElementsID = api.packlist(data)
	Values = api.packlist(ids)

	# Values = ids
else:
	printHeaders = 'Connect number sliders to IdFields and valuesFields Inputs\nConnect FilePath node to csvFile Input'
# ---------- end archicadschedule ----------
read_csv_file = ReadCsvFile()

# ----
# Modify Classification [Elefront Style]: Get Element
# Get Element.Classification
# Modify classification of element
panel_6 = Panel("""Element(to Change)
ClassificationSystem
ClassificationInSystem
Property
PropertyValue""")
elefront_attributes = EleFrontAttributes()  # -> Attributes, Keys, Values, Name, Layer, ColourSource, DisplayColour, MaterialSource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
# Modify Properties[Elefront Style]: Get Element
# Get Element Property / Value
# Modify Property of element
# NOTE: Property lists are unique and dependent on Classification type.
panel_7 = Panel("GetClassificationItemAvailability")

# ==== cluster ReadCsvFile: Cluster that reads data
file = ClusterInput()
read_file = ReadFile(File=file, PerLineParse=True)
separators = ClusterInput()
text_split = TextSplit(Text=read_file, Separators=separators)
flip_matrix = FlipMatrix(Data=text_split)
explode_tree = ExplodeTree(Data=flip_matrix)  # -> Branch0, Branch1, Branch2, Branch3, Branch4, Branch5, Branch6
text = Text(explode_tree.Branch0)
list_item = ListItem(List=flip_matrix, Index=0, Wrap=True)
list_length = ListLength(List=text)
panel = Panel(list_item)
subtraction = Subtraction(A=list_length, B=1)
construct_domain = ConstructDomain(DomainStart=Slider(1, range=0..1), DomainEnd=subtraction)
sub_list = SubList(List=text, Domain=construct_domain, Wrap=True)  # -> List, Index
panel_2 = Panel(sub_list.List)
list = ClusterOutput(sub_list.List)

# ==== cluster FilterElements
elementid = ClusterInput()
criteria = ClusterInput()
values = ClusterInput()
text = Text(values)
ghpython_script = GhPythonScript(ParameterValue=text, ElementID=elementid, CriteriaValue=criteria)  # -> out, a
# ---------- ghpython_script: Python ----------
if CriteriaValue in ParameterValue:
    print ParameterValue,CriteriaValue
    a= ElementID
# ---------- end ghpython_script ----------
pack_values_series = PackValuesSeries(text=ghpython_script.a)
ghpython_script_2 = GhPythonScript(id=pack_values_series)  # -> out, ResultValues
# ---------- ghpython_script_2: Python ----------
import json

lista = json.loads(id)

_lista =[]
for i in lista:
    if len(i)==36:
        _lista.append(i)
        
ResultValues = json.dumps(_lista)
# ---------- end ghpython_script_2 ----------
filteredvalues = ClusterOutput(ghpython_script_2.ResultValues)

# ==== cluster PackValuesSeries: Pack values to one string readable by other nodes
text = ClusterInput()
valuesseries = Text(text)
text_join = TextJoin(ValuesSeries=valuesseries, Join=";")
packvalues = PackValues(Series=text_join, Delimiter=";")  # -> PackedValues
# ---------- packvalues: Python ----------
import api2 as api

if Series is not None:
    lista=[]
    lista = Series.split(Delimiter)
    PackedValues = api.packlist(lista)
# ---------- end packvalues ----------
text_2 = Text(packvalues)
packedvalues = ClusterOutput(text_2)
